# Dynamo graph RotateElements.dyn (Dynamo 1.3.2.2480)

angle_of_rotation = CodeBlock { 1.30; }
project_base_point = Coordinates.BasePoint()
rotate_elements = Python(IN[0]=angle_of_rotation, IN[1]=project_base_point)
# ---------- rotate_elements.python (70 lines) ----------
import clr
import math

clr.AddReference("RevitNodes")
import Revit
clr.ImportExtensions(Revit.Elements)

clr.AddReference('RevitAPI')
import Autodesk
from Autodesk.Revit.DB import *

clr.AddReference('RevitServices')
from RevitServices.Persistence import DocumentManager
from RevitServices.Transactions import TransactionManager

#get current document
doc = DocumentManager.Instance.CurrentDBDocument

#elements in project to rotate
#get the section views
sViews = FilteredElementCollector(doc).OfCategory(BuiltInCategory.OST_Viewers).WhereElementIsNotElementType().ToElements()
#get the elevation views
eViews = FilteredElementCollector(doc).OfCategory(BuiltInCategory.OST_Elev).WhereElementIsNotElementType().ToElements()
#get the scope boxes
sBox = FilteredElementCollector(doc).OfCategory(BuiltInCategory.OST_VolumeOfInterest).WhereElementIsNotElementType().ToElements()
#get the matchlines
matchLines = FilteredElementCollector(doc).OfCategory(BuiltInCategory.OST_Matchline).WhereElementIsNotElementType().ToElements()
#get the model and detail lines
lines =  FilteredElementCollector(doc).OfCategory(BuiltInCategory.OST_Lines).WhereElementIsNotElementType().ToElements()
#get the reference lines & planes
planes = FilteredElementCollector(doc).OfCategory(BuiltInCategory.OST_CLines).WhereElementIsNotElementType().ToElements()
#get input angle
angle = math.radians(IN[0])
#base point for rotation
bPoint = UnwrapElement(IN[1])
#1 create XYZ at base point
p1 = XYZ(bPoint.X,bPoint.Y,bPoint.Z)
#2 create XYZ above base point to generate line
p2 = XYZ(p1.X,p1.Y,p1.Z+1)
#3 generate line for axis
axis = Line.CreateBound(p1,p2)
movedViews = []

#Start Revit Transaction to add to undo list
TransactionManager.Instance.EnsureInTransaction(doc)

#loop through elements to rotate and add to movedViews array for futher modification in Dynamo
for s in sViews:
    Autodesk.Revit.DB.ElementTransformUtils.RotateElement(doc,s.Id,axis,angle)
    movedViews.append(s)
for e in eViews:
    Autodesk.Revit.DB.ElementTransformUtils.RotateElement(doc,e.Id,axis,angle)
    movedViews.append(e)
for sB in sBox:
    Autodesk.Revit.DB.ElementTransformUtils.RotateElement(doc, sB.Id, axis, angle)
    movedViews.append(sB)
for mL in matchLines:
    Autodesk.Revit.DB.ElementTransformUtils.RotateElement(doc, mL.Id, axis, angle)
    movedViews.append(mL)
""" for l in lines:
    Autodesk.Revit.DB.ElementTransformUtils.RotateElement(doc, l.Id, axis, angle)
    movedViews.append(l) """
for pl in planes:
    Autodesk.Revit.DB.ElementTransformUtils.RotateElement(doc, pl.Id, axis, angle)
    movedViews.append(pl)

#Close Revit Transation
TransactionManager.Instance.TransactionTaskDone()

OUT = movedViews
# ----------------------------------------
watch = Watch(rotate_elements)
